# Dynamo graph probim.dyn (Dynamo 2.3.2.15696)

file_path = Filename("..\08_UNIPRO\10_SetDataToFilesOnServer.py")
file_from_path = FileObject(path=file_path)
readText = FileSystem.ReadText(file=file_from_path)
file_path_2 = Filename(".\probim.py")
file_from_path_2 = FileObject(path=file_path_2)
readText_2 = FileSystem.ReadText(file=file_from_path_2)
boolean = BoolSelector(false)
python_script_from_string = PythonStringNode(script=readText_2, IN[0]=boolean)
python_script_from_string_2 = PythonStringNode(script=readText, IN[0]=python_script_from_string)
