# Dynamo graph test.dyn (Dynamo 2.10.1.3976)

file_path = Filename("C:\Dynamo\00_PROBIM\01_checkAllElements.py")
file_from_path = FileObject(path=file_path)
readText = FileSystem.ReadText(file=file_from_path)
boolean = BoolSelector(false)
python_script_from_string = PythonStringNode(script=readText, IN[0]=boolean)  # CPython3
code_block = CodeBlock(a=python_script_from_string) { a.Name; }
getCategory = Element.GetCategory(element=python_script_from_string)
