# Dynamo graph testParameters.dyn (Dynamo 2.12.1.8246)

file_path = Filename(".\03_checkparameters_v2.py")
file_from_path = FileObject(path=file_path)
readText = FileSystem.ReadText(file=file_from_path)
boolean = BoolSelector(false)
python_script_from_string = PythonStringNode(script=readText, IN[0]=boolean)  # CPython3
type = Object.Type(object=python_script_from_string)
