# Dynamo graph MirroredElements.dyn (Dynamo 2.6.1.8786)

boolean = BoolSelector(false)
element_types = ElementTypes("FamilyInstance")
all_elements_of_type = ElementsOfType(element_type=element_types)
python_script = Python(IN[0]=boolean, IN[1]=all_elements_of_type)
# ---------- python_script.python (7 lines) ----------
elem = UnwrapElement(IN[1])
a = []
for e in elem:
	if e.Mirrored:
		a.append(e)

OUT = a
# ----------------------------------------
code_block = CodeBlock { "Комментарии"; "MirroredElement"; }
setParameterByName = Element.SetParameterByName(element=python_script, parameterName=code_block.out0, value=code_block.out1)
