# Dynamo graph Schedules_les9.dyn (Dynamo 2.3.0.5885)

boolean = BoolSelector(true)
имя_параметра_для_записи = StringInput("ПлощадьОтделкиСтен")  # "Имя параметра для записи значения"
python_script = Python(IN[0]=boolean, IN[1]=имя_параметра_для_записи)
# ---------- python_script.python (89 lines) ----------
import clr
clr.AddReference("RevitAPI")
from Autodesk.Revit.DB import FilteredElementCollector, BuiltInCategory, Outline, BoundingBoxIntersectsFilter, \
    FamilyInstance, ElementCategoryFilter, BuiltInParameter, LogicalAndFilter, UnitUtils, \
    SpatialElementBoundaryOptions
clr.AddReference("RevitServices")
from RevitServices.Persistence import DocumentManager
from RevitServices.Transactions import TransactionManager


def getTypeOrInstanceParameter(elem, builtInParameter):
    param = elem.get_Parameter(builtInParameter)
    if param:
        value = param.AsDouble()
        if value:
            return value
        else:
            param = elem.Symbol.get_Parameter(builtInParameter)
            return param.AsDouble()


def getSquare(elem):
    param1 = getTypeOrInstanceParameter(elem, BuiltInParameter.FURNITURE_WIDTH)
    param2 = getTypeOrInstanceParameter(elem, BuiltInParameter.FAMILY_HEIGHT_PARAM)
    if param1 and param2:
        value = param1 * param2
        return value


doc = DocumentManager.Instance.CurrentDBDocument

door_cat = ElementCategoryFilter(BuiltInCategory.OST_Doors)
win_cat = ElementCategoryFilter(BuiltInCategory.OST_Windows)

room_col = FilteredElementCollector(doc).OfCategory(BuiltInCategory.OST_Rooms).ToElements()

elements = []
square_value = []

opt = SpatialElementBoundaryOptions()
TransactionManager.Instance.EnsureInTransaction(doc)

for room in room_col:
    room_height_param = room.get_Parameter(BuiltInParameter.ROOM_HEIGHT)
    segments_list = room.GetBoundarySegments(opt)
    all_length = 0
    elem_in_room = []
    for segments in segments_list:
        for segment in segments:
            element_segement = doc.GetElement(segment.ElementId)
            hasCurtainGrid = hasattr(element_segement, 'CurtainGrid')
            if hasCurtainGrid:
                if element_segement.CurtainGrid is None:
                    all_length += segment.GetCurve().Length
                else:
                    elem_in_room.append(element_segement)
            else:
                hasCurveElementType = hasattr(element_segement, 'CurveElementType')
                if not hasCurveElementType:
                    all_length += segment.GetCurve().Length
                else:
                    elem_in_room.append(element_segement)
    all_square = all_length * room_height_param.AsDouble()
    room_box = room.get_BoundingBox(None)
    param = room.LookupParameter(IN[1])
    if room_box:
        outline = Outline(room_box.Min, room_box.Max)
        bbfilter = BoundingBoxIntersectsFilter(outline)
        doors = FilteredElementCollector(doc).OfClass(FamilyInstance). \
            WherePasses(LogicalAndFilter(bbfilter, door_cat)).ToElements()
        windows = FilteredElementCollector(doc).OfClass(FamilyInstance). \
            WherePasses(LogicalAndFilter(bbfilter, win_cat)).ToElements()
        value = 0
        for door in doors:
            value += getSquare(door)
            elem_in_room.append(door)
        for window in windows:
            if getSquare(window):
                value += getSquare(window)
            elem_in_room.append(window)
        finish_square = all_square - value
        param.Set(finish_square)
    elements.append(elem_in_room)
    square_value.append(UnitUtils.ConvertFromInternalUnits(finish_square, param.DisplayUnitType))


TransactionManager.Instance.TransactionTaskDone()

OUT = elements, square_value
# ----------------------------------------
categories = Categories("OST_Rooms")
all_elements_of_category = ElementsOfCategory(Category=categories)
code_block = CodeBlock { "Тип"; }
getParameterValueByName = Element.GetParameterValueByName(element=all_elements_of_category, parameterName=code_block)
code_block_2 = CodeBlock(a=getParameterValueByName) { a != "(нет)"; }
filterByBoolMask = List.FilterByBoolMask(list=all_elements_of_category, mask=code_block_2)
code_block_3 = CodeBlock { "Тип"; }
getParameterValueByName_2 = Element.GetParameterValueByName(element=filterByBoolMask.in, parameterName=code_block_3)
code_block_4 = CodeBlock { "Ключевое имя"; }
getParameterValueByName_3 = Element.GetParameterValueByName(element=getParameterValueByName_2, parameterName=code_block_4)
parameters = Element.Parameters(element=getParameterValueByName_2)
code_block_5 = CodeBlock { " "; }
code_block_6 = CodeBlock(a=getParameterValueByName_2) { a.Name; }
sortByKey = List.SortByKey(list=filterByBoolMask.in, keys=code_block_6)
groupByKey = List.GroupByKey(list=sortByKey.sorted_list, keys=sortByKey.sorted_keys)
code_block_7 = CodeBlock { "Номер"; }
getParameterValueByName_4 = Element.GetParameterValueByName(element=groupByKey.groups, parameterName=code_block_7)
join = String.Join(separator=code_block_5, string0=getParameterValueByName_4)
count = List.Count(list=groupByKey.groups@L2)
ofRepeatedItem = List.OfRepeatedItem(item=join@L1, amount=count@L1)
code_block_8 = CodeBlock(a=groupByKey.groups) { a; }
