# Dynamo graph Sort.dyn (Dynamo 2.3.0.5885)

# group: Каркас несущий
# note: Получение всех элементов категории "Каркас несущий"
categories = Categories("OST_StructuralFraming")
all_elements_of_category = ElementsOfCategory(Category=categories)

# group: Первый уровень фильтрации. Получаем все элементы со значением "перекрытие цокольное"
code_block = CodeBlock { "_положение конструкции"; }
# note: Фильтрация по параметру "_положение конструкции"
getParameterValueByName = Element.GetParameterValueByName(element=all_elements_of_category, parameterName=code_block)
code_block_2 = CodeBlock(a=getParameterValueByName) { a == "перекрытие цокольное"; }
filterByBoolMask = List.FilterByBoolMask(list=all_elements_of_category, mask=code_block_2)

# group: Второй уровень фильтрации. Получаем все элементы, которые не "обрешетка"
code_block_3 = CodeBlock { "_назначение в конструкции"; }
# note: Фильтрация по параметру "_назначение в конструкции"
getParameterValueByName_2 = Element.GetParameterValueByName(element=filterByBoolMask.in, parameterName=code_block_3)
code_block_4 = CodeBlock(a=getParameterValueByName_2) { a != "обрешетка"; }
filterByBoolMask_2 = List.FilterByBoolMask(list=filterByBoolMask.in, mask=code_block_4)

# group: Сортировка/Группировка по "Комментарии к типоразмеру"
elementType = Element.ElementType(element=filterByBoolMask_2.in)
code_block_5 = CodeBlock { "Комментарии к типоразмеру"; }
getParameterValueByName_3 = Element.GetParameterValueByName(element=elementType, parameterName=code_block_5)
sortByKey = List.SortByKey(list=filterByBoolMask_2.in, keys=getParameterValueByName_3)
reverse = List.Reverse(list=sortByKey.sorted_list)
reverse_2 = List.Reverse(list=sortByKey.sorted_keys)
groupByKey = List.GroupByKey(list=reverse, keys=reverse_2)

# group: Сортировка/Группировка по "ADSK_Длина балки истинная"
code_block_6 = CodeBlock { "ADSK_Длина балки истинная"; }
getParameterValueByName_4 = Element.GetParameterValueByName(element=groupByKey.groups, parameterName=code_block_6)
round = Math.Round(number=getParameterValueByName_4)
sortByKey_2 = List.SortByKey(list=groupByKey.groups@@L2, keys=round@L2)
reverse_3 = List.Reverse(list=sortByKey_2.sorted_list@L2)
reverse_4 = List.Reverse(list=sortByKey_2.sorted_keys@L2)
groupByKey_2 = List.GroupByKey(list=reverse_3@@L2, keys=reverse_4@L2)

# group: Сортировка/Группировка по "_сорт"
code_block_7 = CodeBlock { "_сорт"; }
getParameterValueByName_5 = Element.GetParameterValueByName(element=groupByKey_2.groups, parameterName=code_block_7)
sortByKey_3 = List.SortByKey(list=groupByKey_2.groups@@L2, keys=getParameterValueByName_5@L2)
groupByKey_3 = List.GroupByKey(list=sortByKey_3.sorted_list@@L2, keys=sortByKey_3.sorted_keys@L2)

# group: Запись значений в параметр
code_block_8 = CodeBlock { 2; }
# note: Обрезка списка
flatten = List.Flatten(list=groupByKey_3.groups, amt=code_block_8)
code_block_9 = CodeBlock { "ADSK_Позиция"; }
# note: Получение количества элементвов сгруппированных по 3м параметрам
count = List.Count(list=groupByKey_3.groups@L2)
# note: Получение списка номеров позиции
code_block_10 = CodeBlock(a=count) { 1..List.Count(a); }
# note: Приведение списка нумерации
ofRepeatedItem = List.OfRepeatedItem(item=code_block_10@L1, amount=count@L1)
# note: Перевод числа в строку. Это нужно, если тип данных параметра "Текст"
string_from_object = FromObject(obj=ofRepeatedItem)
# note: Запись значений в параметр
setParameterByName = Element.SetParameterByName(element=flatten, parameterName=code_block_9, value=string_from_object)
