# Dynamo graph Авторазмер-между-стен-и-осей.dyn (Dynamo 0.8.2.2371)

select_model_elements = DSModelElementsSelection()  # 6 picked in the model
restart = BoolSelector(true)
python_script = Python(IN[0]=select_model_elements, IN[1]=restart)
# ---------- python_script.python (18 lines) ----------
import clr
clr.AddReference('ProtoGeometry')
from Autodesk.DesignScript.Geometry import *

sel=[]
elt=[]
type=[]
walls=[]
grids=[]

for i in IN[0]:
	typename = i.GetType().Name
	if typename == "Wall":
		walls.append(i)
	elif typename == "Grid":
		grids.append(i)

OUT=walls, grids
# ----------------------------------------
# note: Walls
code_block = CodeBlock(p=python_script) { p[0]; }
code_block_2 = CodeBlock { "Длина"; }
getParameterValueByName = Element.GetParameterValueByName(element=code_block, parameterName=code_block_2)
minimumItem = List.MinimumItem(getParameterValueByName)
eq = minimumItem == getParameterValueByName
filterByBoolMask = List.FilterByBoolMask(list=code_block, mask=eq)
firstItem = List.FirstItem(filterByBoolMask.in)
# note: Grids
code_block_3 = CodeBlock(p=python_script) { p[1]; }
# note: 0 - short wall
# 1- walls
# 2- grids
# 3 - restart
python_script_2 = Python(IN[0]=firstItem, IN[1]=code_block, IN[2]=code_block_3, IN[3]=restart)
# ---------- python_script_2.python (67 lines) ----------
import clr
clr.AddReference('RevitAPI')
from Autodesk.Revit.DB import *
from System.Collections.Generic import *

clr.AddReference('ProtoGeometry')
from Autodesk.DesignScript.Geometry import *

clr.AddReference("RevitNodes")
import Revit
clr.ImportExtensions(Revit.Elements)
clr.ImportExtensions(Revit.GeometryConversion)
clr.ImportExtensions(Revit.GeometryReferences)

clr.AddReference("RevitServices")
import RevitServices
from RevitServices.Persistence import DocumentManager
from RevitServices.Transactions import TransactionManager

doc = DocumentManager.Instance.CurrentDBDocument
uidoc=DocumentManager.Instance.CurrentUIApplication.ActiveUIDocument

curve=UnwrapElement(IN[0]).Location.Curve.ToProtoType()
pt0=curve.PointAtParameter(0.5)
x0 = curve.PointAtParameter(0).X
x1 = curve.PointAtParameter(1).X
y0 = curve.PointAtParameter(0).Y
y1 = curve.PointAtParameter(1).Y
if abs(y0-y1)<10:
	pt1= Point.ByCoordinates(pt0.X, pt0.Y+1000, pt0.Z)
	line=Line.ByStartPointEndPoint(pt0,pt1).ToRevitType()
elif abs(x0-x1)<10:
	pt1= Point.ByCoordinates(pt0.X+1000, pt0.Y, pt0.Z)
	line=Line.ByStartPointEndPoint(pt0,pt1).ToRevitType()


gopt = Options()
gopt.ComputeReferences = True
view = doc.ActiveView
gopt.View = view

ref= ReferenceArray()
edges=[]
for i in IN[1]:
	wall=UnwrapElement(i)
	geo= wall.get_Geometry(gopt)
	enum = geo.GetEnumerator()
	enum.MoveNext()
	solid = enum.Current
	edges = solid.Edges
	k=0
	for j in edges:
		k=k+1
	ref.Append(edges[0].Reference)
	ref.Append(edges[k-1].Reference)
	
for i in IN[2]:
	ref.Append(UnwrapElement(i).Curve.Reference)


TransactionManager.Instance.EnsureInTransaction(doc)

newdim = doc.Create.NewDimension(view, line, ref)

TransactionManager.Instance.TransactionTaskDone()
OUT=newdim
#OUT=newdim.ToDSType(False)
# ----------------------------------------
