# Dynamo graph ДлинаПрофиля.dyn (Dynamo 2.6.1.8786)

file_path = Filename("..\Tests\length_curve.py")
file_from_path = FileObject(path=file_path)
readText = FileSystem.ReadText(file=file_from_path)
boolean = BoolSelector(false)
color_palette = ColorPalette({R: 255, G: 99, B: 71, A: 255})
python_script_from_string = PythonStringNode(script=readText, IN[0]=boolean, IN[1]=color_palette)
