# Dynamo graph Загатовка.dyn (Dynamo 2.3.0.5885)

file_path = Filename("..\Levels_rename.py")
file_from_path = FileObject(path=file_path)
readText = FileSystem.ReadText(file=file_from_path)
boolean = BoolSelector(true)
python_script_from_string = PythonStringNode(script=readText, IN[0]=boolean)
type = Object.Type(obj=python_script_from_string)
code_block = CodeBlock(a=python_script_from_string) { a.Elevation; }
count = List.Count(list=python_script_from_string)
