# Dynamo graph Загатовка1.dyn (Dynamo 2.3.0.5885)

file_path = Filename("C:\Dynamo\Dynamo\Tests\decal.py")
file_from_path = FileObject(path=file_path)
readText = FileSystem.ReadText(file=file_from_path)
select_model_element = DSModelElementSelection()  # 1 picked in the model
python_script_from_string = PythonStringNode(script=readText, IN[0]=select_model_element)
elementType = Element.ElementType(element=select_model_element)
code_block = CodeBlock(a=elementType) { a.Parameters[5]; }
