# Dynamo graph Параметры.dyn (Dynamo 2.3.0.5885)

file_path = Filename("..\Parameters_ChangeParameterGroup copy.py")
file_from_path = FileObject(path=file_path)
readText = FileSystem.ReadText(file=file_from_path)
boolean = BoolSelector(true)
python_script = Python()  # unwired: IN[0]
# ---------- python_script.python (12 lines) ----------
import clr
clr.AddReference('RevitAPI')
from Autodesk.Revit.DB import FilteredElementCollector, SharedParameterElement, BuiltInParameterGroup

clr.AddReference('RevitServices')
from RevitServices.Persistence import DocumentManager
from RevitServices.Transactions import TransactionManager
doc = DocumentManager.Instance.CurrentDBDocument

params = FilteredElementCollector(doc).OfClass(SharedParameterElement)

OUT = params
# ----------------------------------------
code_block = CodeBlock { ["PG_IDENTITY_DATA", "PG_GENERAL","PG_IDENTITY_DATA", "PG_GENERAL"]; }
python_script_from_string = PythonStringNode(script=readText, IN[0]=boolean, IN[1]=python_script, IN[2]=code_block)
