# Dynamo graph ПередачаНаборов.dyn (Dynamo 2.6.1.8786)

file_path = Filename("..\Tests\GetWorkSets.py")
file_from_path = FileObject(path=file_path)
readText = FileSystem.ReadText(file=file_from_path)
boolean = BoolSelector(false)
file_path_2 = Filename("..\..\..\..\Desktop\Общий.rvt")
python_script_from_string = PythonStringNode(script=readText, IN[0]=boolean, IN[1]=file_path_2)
