# Dynamo graph РавестваСегментовРазмеров.dyn (Dynamo 2.3.0.5885)

# note: Для повтора действия, менять значение в ноде "Повторить" True\False, поочередно
повторить = BoolSelector(false)
имя_типа_размера = StringInput("ИмяТипа")
python_script = Python(IN[0]=повторить, IN[1]=имя_типа_размера)
# ---------- python_script.python (33 lines) ----------
import clr
clr.AddReference("RevitAPI")
from Autodesk.Revit.DB import FilteredElementCollector, Dimension
clr.AddReference("RevitServices")
from RevitServices.Persistence import DocumentManager
from RevitServices.Transactions import TransactionManager


doc = DocumentManager.Instance.CurrentDBDocument


typename = IN[1]  # noqa

elements = FilteredElementCollector(doc).OfClass(Dimension).ToElements()

changed = []
TransactionManager.Instance.EnsureInTransaction(doc)

for el in elements:
    if typename in el.Name:
        changed.append(el)
        segments = el.Segments
        if el.NumberOfSegments != 0:
            el.AreSegmentsEqual = False
            el.AreSegmentsEqual = True
            for segment in segments:
                segment.ValueOverride = "1/{}".format(el.NumberOfSegments)
        else:
            el.ValueOverride = ''

TransactionManager.Instance.TransactionTaskDone()

OUT = changed
# ----------------------------------------
