# Dynamo graph Раскрой.dyn (Dynamo 2.0.2.6826)

file_path = Filename("C:\Users\user\OneDrive - repurpose collaborative experiences\09_GitHub\Dynamo-1\Test.py")
file_from_path = FileObject(path=file_path)
readText = FileSystem.ReadText(file=file_from_path)
watch = Watch(readText)
forceChildsEval = ForceChildsEval()  # unwired: passObject
python_script_from_string = PythonStringNode(IN[0]=forceChildsEval)  # frozen; unwired: script
count = List.Count(list=python_script_from_string@L2)
more = CodeBlock { [7,5,9,8,5.5]; }
less = CodeBlock { [1,4,2,3]; }
add = more + less  # lacing=CrossProduct
code_block = CodeBlock(a=add) { a > 10? 0: a; }
less_2 = CodeBlock { [1,4,2,4]; }
maximumItem = List.MaximumItem(list=less_2)
eq = less_2 == maximumItem
code_block_2 = CodeBlock { true; }
indexOf = List.IndexOf(list=eq@L2, element=code_block_2)
type = Object.Type(obj=maximumItem)
python_script_from_string_2 = PythonStringNode(script=readText, IN[0]=more, IN[1]=less)
sum = Math.Sum(values=python_script_from_string_2)
