# Dynamo graph Раскрой_V2.dyn (Dynamo 2.0.2.6826)

file_path = Filename("C:\Users\user\OneDrive - repurpose collaborative experiences\09_GitHub\Dynamo-1\Test copy.py")
file_from_path = FileObject(path=file_path)
readText = FileSystem.ReadText(file=file_from_path)
file_path_2 = Filename("C:\Users\user\Desktop\Спецификация обобщенной модели.csv")
importCSV = Data.ImportCSV(filePath=file_path_2)
code_block = CodeBlock(a=importCSV) { a[0]; }
python_script_from_string = PythonStringNode(script=readText, IN[0]=code_block)
