# Dynamo graph Сортировка.dyn (Dynamo 2.0.2.6826)

code_block = CodeBlock { ["доска 45x195","доска 45x195", "доска 45x95", "доска 20x195", "доска 20x195"]; }
code_block_2 = CodeBlock { " "; }
split = String.Split(str=code_block, separater0=code_block_2)
transpose = List.Transpose(lists=split)
code_block_3 = CodeBlock(a=transpose) { a[1]; }
code_block_4 = CodeBlock { "x"; }
split_2 = String.Split(str=code_block_3, separater0=code_block_4)
transpose_2 = List.Transpose(lists=split_2)
code_block_5 = CodeBlock(a=transpose_2) { a[0]; }
toNumber = String.ToNumber(str=code_block_5)
sortByKey = List.SortByKey(list=code_block, keys=toNumber)
groupByKey = List.GroupByKey(list=sortByKey.sorted_list, keys=sortByKey.sorted_keys)
code_block_6 = CodeBlock { "x"; }
split_3 = String.Split(str=groupByKey.groups, separater0=code_block_6)
transpose_3 = List.Transpose(lists=split_3@L3)
code_block_7 = CodeBlock { 1; }
getItemAtIndex = List.GetItemAtIndex(list=transpose_3@L3, index=code_block_7)
toNumber_2 = String.ToNumber(str=getItemAtIndex)
sortByKey_2 = List.SortByKey(list=groupByKey.groups@L2, keys=toNumber_2@L2)
flatten = List.Flatten(list=sortByKey_2.sorted_list)
code_block_8 = CodeBlock(a=flatten) { a; }
