# Dynamo graph ЧисткаВидов.dyn (Dynamo 2.0.2.6826)

file_path = Filename("..\Views_unused.py")
file_from_path = FileObject(path=file_path)
readText = FileSystem.ReadText(file=file_from_path)
boolean = BoolSelector(false)
python_script_from_string = PythonStringNode(script=readText, IN[0]=boolean)
type = Object.Type(obj=python_script_from_string)
не_на_листах = CodeBlock(el=python_script_from_string)
# ---------- не_на_листах.designscript (7 lines) ----------
treeD = el[0];
draftingView = el[1];
section = el[2];
floorPlan = el[3];
legend = el[4];
schedule = el[5];
copyName = el[6];
# ----------------------------------------
code_block = CodeBlock(floorPlan=не_на_листах.floorPlan) { floorPlan; }
code_block_2 = CodeBlock { "Номер листа"; "Имя листа"; }
getParameterValueByName = Element.GetParameterValueByName(element=code_block, parameterName=code_block_2.out1)
code_block_3 = CodeBlock(draftingView=не_на_листах.draftingView) { draftingView; }
code_block_4 = CodeBlock(section=не_на_листах.section) { section; }
code_block_5 = CodeBlock(legend=не_на_листах.legend) { legend; }
code_block_6 = CodeBlock(schedule=не_на_листах.schedule) { schedule; }
count = List.Count(list=python_script_from_string@L2)
sum = Math.Sum(values=count)
lastItem = List.LastItem(list=count)
code_block_7 = CodeBlock(a=sum, b=lastItem) { a - b; }
code_block_8 = CodeBlock(treeD=не_на_листах.treeD) { treeD; }
id = Element.Id(element=code_block_8)
list_create = List.Create(item0=code_block_8, item1=id)
transpose = List.Transpose(lists=list_create)
file_path_2 = Filename("..\..\..\..\Desktop\Лист Microsoft Excel.xlsx")
code_block_9 = CodeBlock { "Копия1"; "3D"; "Чертежные виды"; "Разрезы"; "Планы этажей"; "Легенды"; "Спецификации"; }
code_block_10 = CodeBlock { 0; }
code_block_11 = CodeBlock(copyName=не_на_листах.copyName) { copyName; }
code_block_12 = CodeBlock(a=code_block_11) { a.Name; }
id_2 = Element.Id(element=code_block_11)
list_create_2 = List.Create(item0=code_block_11, item1=code_block_12, item2=id_2)
transpose_2 = List.Transpose(lists=list_create_2)
exportExcel = Data.ExportExcel(filePath=file_path_2, sheetName=code_block_9.out0, startRow=code_block_10, startCol=code_block_10, data=transpose_2)
