# Dynamo graph voronoi.dyn (Dynamo 2.3.0.5885)

размер_панели = CodeBlock { 1000; }
толщина = CodeBlock { 20; }

# group: Создание прямоугольника заданного размера
code_block = CodeBlock(a=размер_панели, b=толщина) { a-b; }
code_block_2 = CodeBlock(a=code_block, c=толщина) { Point.ByCoordinates(0,1,a/2+c/2); Point.ByCoordinates(0,-1,a/2+c/2); }
byStartPointEndPoint = Line.ByStartPointEndPoint(startPoint=code_block_2.out0, endPoint=code_block_2.out1)
code_block_3 = CodeBlock(line=byStartPointEndPoint) { Curve.PlaneAtParameter(line, 0.5); }
byPlane = CoordinateSystem.ByPlane(plane=code_block_3)
byWidthLength = Rectangle.ByWidthLength(cs=byPlane, width=code_block, length=code_block)

byPatch = Surface.ByPatch(closedCurve=byWidthLength)
количество_точек = CodeBlock { 50; }

# group: Генерация точек
randomList = Math.RandomList(amount=количество_точек)
randomList_2 = Math.RandomList(amount=количество_точек)
pointAtParameter = Surface.PointAtParameter(surface=byPatch, u=randomList, v=randomList_2)

UVParameterAtPoint = Surface.UVParameterAtPoint(surface=byPatch, point=pointAtParameter)
byParametersOnSurface = Tessellation.Voronoi.ByParametersOnSurface(uvs=UVParameterAtPoint, face=byPatch)
ширина = CodeBlock { 80; }

# group: Создание геометрии
byPatch_2 = Surface.ByPatch(closedCurve=byWidthLength)
normal = Plane.Normal(plane=code_block_3)
code_block_4 = CodeBlock { 50; }
extrude = Curve.Extrude(curve=byParametersOnSurface, direction=normal, distance=code_block_4)
byJoinedSurfaces = PolySurface.ByJoinedSurfaces(surfaces=extrude)
translate = Geometry.Translate(geometry=byJoinedSurfaces, yTranslation=code_block_4)
split = Geometry.Split(geometry=byPatch_2, other=translate)
perimeterCurves = Surface.PerimeterCurves(surface=split)
extrude_2 = Curve.Extrude(curve=perimeterCurves, direction=normal, distance=ширина)
byUnion = Surface.ByUnion(surfaces=extrude_2)
thicken = Surface.Thicken(surface=byUnion, thickness=толщина)
byUnion_2 = Solid.ByUnion(solids=thicken)

byGeometry = ImportInstance.ByGeometry(geometry=byUnion_2)
