# Dynamo graph СозданиеCSV_Пластины.dyn (Dynamo 2.12.0.5650)

file_path = Filename("C:\Users\BIM_Cadet\Desktop\Revit\_пластины.csv")
code_block = CodeBlock { ",t##length##millimeters,h##length##millimeters"; }
code_block_2 = CodeBlock()
# ---------- code_block_2.designscript (28 lines) ----------
String.Split("
2.5
3
4
5
6
8
10
12
14
16
18
20
22
25
28
30
32
36
40
45
50
60
80
100
120
140
160","\n");
# ----------------------------------------
code_block_3 = CodeBlock { 50..300; }
count = List.Count(list=code_block_3)
ofRepeatedItem = List.OfRepeatedItem(item=code_block_2, amount=count)
count_2 = List.Count(list=code_block_2)
ofRepeatedItem_2 = List.OfRepeatedItem(item=code_block_3@L1, amount=count_2)
code_block_4 = CodeBlock(t=ofRepeatedItem, h=ofRepeatedItem_2) { "—"+t+"x"+h; }
code_block_5 = CodeBlock(a=code_block_4, b=ofRepeatedItem, c=ofRepeatedItem_2) { a+","+b+","+c; }
flatten = List.Flatten(list=code_block_5)
addItemToFront = List.AddItemToFront(item=code_block, list=flatten)
exportCSV = Data.ExportCSV(filePath=file_path, data=addItemToFront)
