# Dynamo graph JoinFloor&Foundation.dyn (Dynamo 2.3.0.5885)

file_path = Filename("C:\Users\BIM_Cadet\Desktop\Git\Dynamo\07_ECO\JoinFloor&Foundation.py")
file_from_path = FileObject(path=file_path)
readText = FileSystem.ReadText(file=file_from_path)
boolean = BoolSelector(false)
code_block = CodeBlock { "LC4"; }
wall_types = WallTypes("01_Concrete_200 mm")
code_block_2 = CodeBlock(a=wall_types) { a.Name; }
python_script_from_string = PythonStringNode(script=readText, IN[0]=boolean, IN[1]=code_block, IN[2]=code_block_2)  # unwired: IN[3]
type = Object.Type(obj=python_script_from_string)
