# Dynamo custom node Path.dyf (Dynamo 2.3.0.5885)
# category: Shvydko

path = Input(path: var[]..[])
file_from_path = FileObject(path=path)
readText = FileSystem.ReadText(file=file_from_path)
isrepeat = Input(isrepeat: var[]..[])
separator = Input(separator: var[]..[])
python_script_from_string = PythonStringNode(script=readText, IN[0]=isrepeat, IN[1]=separator)
result = Output(python_script_from_string)
