# Dynamo graph UNI_AssemblyCodeFromExcel.dyn (Dynamo 2.3.2.15696)

code_block = CodeBlock { "2.8_плитка Тех.пом._по внутренним стенам по бетону"; }
path_to_excel = Filename(".\Коды по классификатору.xls")  # graph input
file_from_path = FileObject(path=path_to_excel)
sheet_name = StringInput("Стены")  # graph input
code_block_2 = CodeBlock(filePath=file_from_path, sheetName=sheet_name)
# ---------- code_block_2.designscript (8 lines) ----------
file = DSOffice.Data.ImportExcel(filePath, sheetName, false, true);
data = List.Transpose(file);
codes = data[0];
types = data[2];
mask = codes != null;
f_codes = List.FilterByBoolMask(codes, mask)["in"];
f_types = List.FilterByBoolMask(types, mask)["in"];
Dictionary.ByKeysValues(f_types, f_codes);
# ----------------------------------------
python_script = Python(IN[0]=code_block_2.out7, IN[1]=sheet_name)
# ---------- python_script.python (44 lines) ----------
# -*- coding: utf-8 -*-
import clr
clr.AddReference("RevitAPI")
from Autodesk.Revit.DB import FilteredElementCollector, WallType, FloorType, CeilingType
clr.AddReference("RevitServices")
from RevitServices.Persistence import DocumentManager
from RevitServices.Transactions import TransactionManager
doc = DocumentManager.Instance.CurrentDBDocument
data = IN[0]
sheet_name = IN[1]


def get_all_types(document, elemType):
    return FilteredElementCollector(document).OfClass(elemType).ToElements()


def set_assembly_code(type_list, data):
    from Autodesk.Revit.DB import BuiltInParameter
    result = []
    for elem in type_list:
        name = elem.get_Parameter(BuiltInParameter.ALL_MODEL_TYPE_NAME).AsString()
        assembly_param = elem.get_Parameter(BuiltInParameter.UNIFORMAT_CODE)
        try:
            value = data[name]
            if value == 999:
                assembly_param.Set("999")
            else:
                assembly_param.Set(value)
            result.append("{} - DONE".format(name))
        except KeyError as e:
            result.append("{} - UNDONE".format(name))
    return result


TransactionManager.Instance.EnsureInTransaction(doc)
if sheet_name == "Стены":
    result = set_assembly_code(get_all_types(doc, WallType), data)
elif sheet_name == "Перекрытия":
    result = set_assembly_code(get_all_types(doc, FloorType), data)
elif sheet_name == "Потолок":
    result = set_assembly_code(get_all_types(doc, CeilingType), data)
TransactionManager.Instance.TransactionTaskDone()

OUT = result
# ----------------------------------------
code_block_3 = CodeBlock(result=python_script)
# ---------- code_block_3.designscript (3 lines) ----------
mask = String.Contains(result, "UNDONE", false);
info = List.FilterByBoolMask(result, mask)["in"];
String.Remove(info, String.Length(info)-9,9);
# ----------------------------------------
python_script_2 = Python(IN[0]=code_block_3.out2, IN[1]=sheet_name)
# ---------- python_script_2.python (16 lines) ----------
import os
import clr
from io import open
from datetime import datetime
data = IN[0]
clr.AddReference("RevitServices")
from RevitServices.Persistence import DocumentManager
doc = DocumentManager.Instance.CurrentDBDocument
date = datetime.now()
homedir = os.path.expanduser('~') + r'\\Desktop\\{}_{}_{}.txt'.format(doc.Title, IN[1], date.strftime("%Y%m%d_%H%M%S"))
with open(homedir, 'w', newline='') as file:
    for d in data:
        file.write(d + '\n')
    file.close()

OUT = data
# ----------------------------------------
