# Dynamo graph UNI_AssemblyCodeFromExcel_v2.dyn (Dynamo 2.3.2.15696)

path_to_excel = Filename(".\Коды по классификатору (2).xlsx")  # graph input
file_from_path = FileObject(path=path_to_excel)
sheet_name = StringInput("Потолок")  # graph input
code_block = CodeBlock(filePath=file_from_path, sheetName=sheet_name)
# ---------- code_block.designscript (8 lines) ----------
file = DSOffice.Data.ImportExcel(filePath, sheetName, false, true);
data = List.Transpose(file);
codes = data[0];
types = data[2];
mask = codes != null;
f_codes = List.FilterByBoolMask(codes, mask)["in"];
f_types = List.FilterByBoolMask(types, mask)["in"];
Dictionary.ByKeysValues(f_types, f_codes);
# ----------------------------------------
python_script = Python(IN[0]=code_block.out7, IN[1]=sheet_name)
# ---------- python_script.python (49 lines) ----------
# -*- coding: utf-8 -*-
import clr
clr.AddReference("RevitAPI")
from Autodesk.Revit.DB import FilteredElementCollector, WallType, FloorType, CeilingType, SlabEdgeType
clr.AddReference("RevitServices")
from RevitServices.Persistence import DocumentManager
from RevitServices.Transactions import TransactionManager
doc = DocumentManager.Instance.CurrentDBDocument
data = IN[0]
sheet_name = IN[1]


def get_all_types(document, elemType):
    return FilteredElementCollector(document).OfClass(elemType).ToElements()


def set_assembly_code(type_list, data):
    from Autodesk.Revit.DB import BuiltInParameter
    result = []
    for elem in type_list:
        name = elem.get_Parameter(BuiltInParameter.ALL_MODEL_TYPE_NAME).AsString()
        assembly_param = elem.get_Parameter(BuiltInParameter.UNIFORMAT_CODE)
        for key in data.keys():
            if key in name:
                value = data[key]
                if value == 999:
                    assembly_param.Set("999")
                else:
                    assembly_param.Set(value)
                info = 'DONE'
                break
            else:
                info = 'UNDONE'
        result.append("{} - {}".format(name, info))
    return result


TransactionManager.Instance.EnsureInTransaction(doc)
if sheet_name == "Стены":
    result = set_assembly_code(get_all_types(doc, WallType), data)
elif sheet_name == "Перекрытия":
    result = set_assembly_code(get_all_types(doc, FloorType), data)
elif sheet_name == "Потолок":
    result = set_assembly_code(get_all_types(doc, CeilingType), data)
elif sheet_name == "Ребра плит":
    result = set_assembly_code(get_all_types(doc, SlabEdgeType), data)
TransactionManager.Instance.TransactionTaskDone()

OUT = result
# ----------------------------------------
code_block_2 = CodeBlock(result=python_script)
# ---------- code_block_2.designscript (4 lines) ----------
mask = String.Contains(result, "UNDONE", false);
info = List.FilterByBoolMask(result, mask)["in"];
data = String.Remove(info, String.Length(info)-9,9);
List.Sort(data);
# ----------------------------------------
python_script_2 = Python(IN[0]=code_block_2.out3, IN[1]=sheet_name)
# ---------- python_script_2.python (16 lines) ----------
import os
import clr
from io import open
from datetime import datetime
data = IN[0]
clr.AddReference("RevitServices")
from RevitServices.Persistence import DocumentManager
doc = DocumentManager.Instance.CurrentDBDocument
date = datetime.now()
homedir = os.path.expanduser('~') + r'\\Desktop\\{}_{}_{}.txt'.format(doc.Title, IN[1], date.strftime("%Y%m%d_%H%M%S"))
with open(homedir, 'w', newline='') as file:
    for d in data:
        file.write(d + '\n')
    file.close()

OUT = data
# ----------------------------------------
