# Dynamo graph UNI_SetParametrValueToServerFiles.dyn (Dynamo 2.10.1.3976)

file_path = Filename("C:\Dynamo\08_UNIPRO\10_SetDataToFilesOnServer.py")
file_from_path = FileObject(path=file_path)
readText = FileSystem.ReadText(file=file_from_path)
code_block = CodeBlock()
# ---------- code_block.designscript (3 lines) ----------
[
"_ThePilotProject"
];
# ----------------------------------------
code_block_2 = CodeBlock { "Стена 1"; }
code_block_3 = CodeBlock { "unipro"; }
python_script_from_string = PythonStringNode(script=readText, IN[0]=code_block, IN[1]=code_block_2, IN[2]=code_block_3)  # IronPython2
type = Object.Type(obj=python_script_from_string)
