# Dynamo graph UNI_SetParametrValueToWallTypeOnServerFiles.dyn (Dynamo 2.6.1.8786)

boolean = BoolSelector(false)
директория_на_сервере = StringInput("RSN://10.10.1.29/004_Ilmensky_2/004-01_WIP/AR/Sections")  # graph input
файлы = CodeBlock()
# ---------- файлы.designscript (41 lines) ----------
[
"ILMN02_AR_Section_01",
"ILMN02_AR_Section_01_F",
"ILMN02_AR_Section_02",
"ILMN02_AR_Section_02_F",
"ILMN02_AR_Section_03",
"ILMN02_AR_Section_03_F",
"ILMN02_AR_Section_04",
"ILMN02_AR_Section_04_F",
"ILMN02_AR_Section_05",
"ILMN02_AR_Section_05_F",
"ILMN02_AR_Section_06",
"ILMN02_AR_Section_06_F",
"ILMN02_AR_Section_07",
"ILMN02_AR_Section_07_F",
"ILMN02_AR_Section_08",
"ILMN02_AR_Section_08_F",
"ILMN02_AR_Section_09",
"ILMN02_AR_Section_09_F",
"ILMN02_AR_Section_10",
"ILMN02_AR_Section_10_F",
"ILMN02_AR_Section_11",
"ILMN02_AR_Section_11_F",
"ILMN02_AR_Section_12",
"ILMN02_AR_Section_12_F",
"ILMN02_AR_Section_13",
"ILMN02_AR_Section_13_F",
"ILMN02_AR_Section_14",
"ILMN02_AR_Section_14_F",
"ILMN02_AR_Section_15",
"ILMN02_AR_Section_15_F",
"ILMN02_AR_Section_16",
"ILMN02_AR_Section_16_F",
"ILMN02_AR_Section_17",
"ILMN02_AR_Section_17_F",
"ILMN02_AR_Section_18",
"ILMN02_AR_Section_18_F",
"ILMN02_AR_STLB01_F",
"ILMN02_AR_STLB02_F",
"ILMN02_AR_STLB03_F"
];
# ----------------------------------------
code_block = CodeBlock { "_F"; }
contains = String.Contains(str=файлы, searchFor=code_block)
filterByBoolMask = List.FilterByBoolMask(list=файлы, mask=contains)
имя_типа = CodeBlock { "тест"; }
имя_параметра = CodeBlock { "Комментарии"; }
значение = CodeBlock { "Фасад"; }
python_script = Python(IN[0]=boolean, IN[1]=директория_на_сервере, IN[2]=filterByBoolMask.in, IN[3]=имя_типа, IN[4]=имя_параметра, IN[5]=значение)  # frozen
# ---------- python_script.python (75 lines) ----------
import clr
import os
clr.AddReference("RevitAPI")
clr.AddReference("RevitServices")
from RevitServices.Persistence import DocumentManager
uiapp = DocumentManager.Instance.CurrentUIApplication
app = uiapp.Application


def create_path(server_folder, file_name):
    from Autodesk.Revit.DB import ModelPathUtils
    return ModelPathUtils.ConvertUserVisiblePathToModelPath(os.path.join(server_folder, file_name) + '.rvt')


def synchronize_with_central(document, name):
    from Autodesk.Revit.DB import TransactWithCentralOptions, SynchronizeWithCentralOptions, RelinquishOptions
    r_opt = RelinquishOptions(True)
    r_opt.UserWorksets = True
    r_opt.CheckedOutElements = True
    r_opt.StandardWorksets = True
    trans_opt = TransactWithCentralOptions()
    synchro_opt = SynchronizeWithCentralOptions()
    synchro_opt.Comment = name
    synchro_opt.SetRelinquishOptions(r_opt)
    document.SynchronizeWithCentral(trans_opt, synchro_opt)


def set_value_to_wall_or_walltype_parameter(document, wall_type_name, param_name, value):
    from Autodesk.Revit.DB import FilteredElementCollector, Wall, BuiltInParameter
    all_walls = FilteredElementCollector(document).OfClass(Wall).ToElements()
    result = []
    for wall in all_walls:
        type_name = wall.WallType.get_Parameter(BuiltInParameter.SYMBOL_NAME_PARAM).AsString()
        if wall_type_name.lower() in type_name.lower():
            param = wall.LookupParameter(param_name)
            if param:
                result.append('instance - {}'.format(param.Definition.Name))
                param.Set(value)
            else:
                wall_type = wall.WallType
                param = wall_type.LookupParameter(param_name)
                if param:
                    result.append('type - {}'.format(param.Definition.Name))
                    param.Set(value)
                else:
                    result.append("There is no parameter")
    return result


def open_and_change_document(server_folder, file_name, wall_type_name, param_name, data):
    from Autodesk.Revit.DB import OpenOptions, Transaction
    o_opt = OpenOptions()
    path = create_path(server_folder, file_name)
    document = app.OpenDocumentFile(path, o_opt)
    t = Transaction(document, set_value_to_wall_or_walltype_parameter.__name__)
    t.Start()
    result = set_value_to_wall_or_walltype_parameter(document, wall_type_name, param_name, data)
    t.Commit()
    synchronize_with_central(document, 'in {} set {}'.format(param_name, data))
    document.Close(False)
    return result


server_path = IN[1]
files = IN[2]
wall_type_name = IN[3]
param_name = IN[4]
data = IN[5]

info = []
for f in files:
    result = open_and_change_document(server_path, f, wall_type_name, param_name, data)
    info.append(result)

OUT = info
# ----------------------------------------
