# Dynamo graph Получение Укальных РабочихНаборов Из ЛинкФайлов.dyn (Dynamo 2.0.2.6826)

file_path = Filename("C:\Users\user\OneDrive - repurpose collaborative experiences\09_GitHub\Dynamo-1\Worksets_GetAllFromLinks_v2.py")
file_from_path = FileObject(path=file_path)
readText = FileSystem.ReadText(file=file_from_path)
python_script_from_string = PythonStringNode(script=readText)  # unwired: IN[0]
code_block = CodeBlock(a=python_script_from_string) { a[0]; }
code_block_2 = CodeBlock(a=python_script_from_string) { a[1]; }
flatten = List.Flatten(list=code_block_2)
uniqueItems = List.UniqueItems(list=flatten)
sort = List.Sort(list=uniqueItems)
sort_2 = List.Sort(list=code_block_2)
count = List.Count(list=code_block_2@L2)
