# Dynamo graph Заготовка.dyn (Dynamo 2.0.3.8810)

file_path = Filename("C:\Users\sssh\OneDrive\09_GitHub\Dynamo\Dynamo\Tests\01_SM\coordinates.py")
file_from_path = FileObject(path=file_path)
readText = FileSystem.ReadText(file=file_from_path)
python_script_from_string = PythonStringNode(script=readText)  # unwired: IN[0]
