# Dynamo graph Square.dyn (Dynamo 2.6.1.8786)

file_path = Filename("C:\Users\Sergio-Mac\Documents\Dynamo\Tests\03_Archio\square.py")  # graph input
fromPath = FileObject(path=file_path)  # "File.FromPath"
readText = FileSystem.ReadText(file=fromPath)
boolean = BoolSelector(true)  # graph input
select_model_element = DSModelElementSelection()  # 1 picked in the model; graph input
python_script_from_string = PythonStringNode(script=readText, IN[0]=boolean, IN[1]=select_model_element)
geometry = Element.Geometry(element=select_model_element)
byGeometry = BoundingBox.ByGeometry(geom=geometry)
toCuboid = BoundingBox.ToCuboid(boundingBox=byGeometry)
volume = Solid.Volume(solid=toCuboid)
convert_between_units = DynamoConvert(volume, MeasurementType="Volume", FromConversion="CubicMillimeter", ToConversion="CubicMeters")
maxPoint = BoundingBox.MaxPoint(boundingBox=byGeometry)
code_block = CodeBlock(a=maxPoint) { a.X; }
minPoint = BoundingBox.MinPoint(boundingBox=byGeometry)
code_block_2 = CodeBlock(a=minPoint) { a.X; }
длина = CodeBlock(a=code_block, b=code_block_2) { a-b; }
code_block_3 = CodeBlock(a=maxPoint) { a.Y; }
code_block_4 = CodeBlock(a=minPoint) { a.Y; }
ширина = CodeBlock(a=code_block_3, b=code_block_4) { a-b; }
code_block_5 = CodeBlock(a=maxPoint) { a.Z; }
code_block_6 = CodeBlock(a=minPoint) { a.Z; }
высота = CodeBlock(a=code_block_5, b=code_block_6) { a-b; }
code_block_7 = CodeBlock(a=длина, b=ширина, c=высота) { a*b*c; }
