# Dynamo graph toSTL.dyn (Dynamo 2.6.1.8786)

file_path = Filename("C:\Users\sssh\OneDrive\09_GitHub\Dynamo\Dynamo-1\Tests\03_Archio\Export_to_stl.py")
file_from_path = FileObject(path=file_path)
readText = FileSystem.ReadText(file=file_from_path)
boolean = BoolSelector(false)
python_script_from_string = PythonStringNode(script=readText, IN[0]=boolean)
