# Dynamo graph 01_DetailLines.dyn (Dynamo 2.12.1.8246)

file_path = Filename("C:\Users\BIM_Cadet\Desktop\Git\Dynamo\revitapi\Linkedin\01_DetailLines.py")
file_from_path = FileObject(path=file_path)
readText = FileSystem.ReadText(file=file_from_path)
boolean = BoolSelector(false)
element_types = ElementTypes("DetailLine")
all_elements_of_type = ElementsOfType(element_type=element_types)
python_script_from_string = PythonStringNode(script=readText, IN[0]=boolean, IN[1]=all_elements_of_type)  # CPython3
watch = Watch(python_script_from_string)
code_block = CodeBlock { "id"; }
valueAtKey = DesignScript.Builtin.Dictionary.ValueAtKey(dictionary=python_script_from_string, key=code_block)
element_types_2 = ElementTypes("DetailLine")
all_elements_of_type_2 = ElementsOfType(element_type=element_types_2)
python_script = Python(IN[0]=all_elements_of_type_2)  # IronPython2; starter script, not edited (OUT = 0)
code_block_2 = CodeBlock(a=all_elements_of_type) { a.Name; }
