# Dynamo graph Загатовка.dyn (Dynamo 2.0.2.6826)

file_path = Filename(".\Schedule_Create.py")
file_from_path = FileObject(path=file_path)
readText = FileSystem.ReadText(file=file_from_path)
code_block = CodeBlock { "Окна"; }
code_block_2 = CodeBlock { ["Ширина", "Высота"]; }
boolean = BoolSelector(false)
python_script_from_string = PythonStringNode(script=readText, IN[0]=code_block, IN[1]=code_block_2, IN[2]=boolean)
type = Object.Type(obj=python_script_from_string)
